# Grasshopper definition WS_MASTER_USER_OBJECTS.gh (Grasshopper 1.0.7)
# Copyright: Ralph.Schroetter@gmail.com
# plug-ins: Bifocals

# GEOMETRY: TO THE POINT AND BEYOND
# 1 BASICS
wsgh_comments = WSGH_comments()  # -> out, a; disabled
# ---------- wsgh_comments: Python ----------
#write yourself a comment

"""write yourself
a multi line
comment"""
# ---------- end wsgh_comments ----------
wsgh_operators = WSGH_operators()  # -> out, a; inputs x: Int32, y: Int32; disabled
# ---------- wsgh_operators: Python ----------
__author__ = "Sculpture"
__version__ = "2021.01.18"

import rhinoscriptsyntax as rs

print (x+y)
print (x-y)
print (x*y)
print (x/y)
print (x**y)
print (x%y)
print (x//y)
# ---------- end wsgh_operators ----------
wsgh_increment_decrement = WSGH_incrementDecrement()  # -> out, a; inputs x: Int32, y: Int32; disabled
# ---------- wsgh_increment_decrement: Python ----------
__author__ = "Sculpture"
__version__ = "2021.01.18"

import rhinoscriptsyntax as rs

x += y
#x -= y
#x *= y
x /= y

print (x)
# ---------- end wsgh_increment_decrement ----------
wsgh_comparisonlogicaloperators = WSGH_comparisonLogicalOperators()  # -> out, a; inputs x: Int32, y: Int32; disabled
# ---------- wsgh_comparisonlogicaloperators: Python ----------
__author__ = "Sculpture"
__version__ = "2021.01.18"

import rhinoscriptsyntax as rs

if x > y:
    print("Greater than")
elif x < y:
    print("Lesser than")
else:
    print ("equal to")
# ---------- end wsgh_comparisonlogicaloperators ----------
wsgh_loop = WSGH_loop()  # -> out, a; inputs x: Int32, y: Int32, z: Int32; disabled
# ---------- wsgh_loop: Python ----------
__author__ = "Sculpture"
__version__ = "2021.01.18"

import rhinoscriptsyntax as rs

for i in range(x):
    print i
print" "
for i in range(x,y):
    print i
print" "
for i in range(x,y,z):
    print i
# ---------- end wsgh_loop ----------
wsgh_list = WSGH_list()  # -> out, a; inputs x: Int32, y: Int32, z: Int32; disabled
# ---------- wsgh_list: Python ----------
__author__ = "Sculpture"
__version__ = "2021.01.18"

import rhinoscriptsyntax as rs

List = [x,y,z]

print (List)
print (List[0])
print (List[-1])
print (len(List))
print (max(List))
print (min(List))
List.sort()
print (List)
List.insert(2,99)
print (List)
List.append(66)
print (List)
del List[2]
print (List)
print (List.pop(1))
print (List)
List2 = (List[:2:])
print (List2)
# ---------- end wsgh_list ----------
wsgh_append_extend = WSGH_appendExtend()  # -> out, a; inputs x: Int32, y: Int32, z: Int32; disabled
# ---------- wsgh_append_extend: Python ----------
__author__ = "Sculpture"
__version__ = "2021.01.18"

import rhinoscriptsyntax as rs

ListA = [x,y,z]
ListB = [x+y,y+z,z+x]

ListA.append(ListB)
print (ListA)
print" "

ListA.extend(ListB)
print (ListA)
print" "
# ---------- end wsgh_append_extend ----------
wsgh_function = WSGH_function()  # -> out, a; inputs x: Int32, y: Int32; disabled
# ---------- wsgh_function: Python ----------
__author__ = "Sculpture"
__version__ = "2021.01.18"

import rhinoscriptsyntax as rs

def RectArea(length, width):
    area = length * width
    return area

print (RectArea(x,y))
# ---------- end wsgh_function ----------
wsgh_function2 = WSGH_function2()  # -> out, a; inputs x: Int32, y: Int32; disabled
# ---------- wsgh_function2: Python ----------
__author__ = "Sculpture"
__version__ = "2021.01.18"

import rhinoscriptsyntax as rs

def LoopFunction(num,t):
    for i in range(1,t):
        num *= i
        print (num)

LoopFunction(x,y)
# ---------- end wsgh_function2 ----------
ttp_mathlibraryenum = TTP_mathLibraryEnum()  # -> out, pts_out; inputs enum: Int32; disabled
# ---------- ttp_mathlibraryenum: Python ----------
import rhinoscriptsyntax as rs
import math as m

pts =[]

for i in rs.frange(fstart, 100.0, fstep):
    
    if enum == 0:
        x = i*m.sin(i)
        y = i*m.log1p(i)
        z = i
    else:
        x = i*m.sin(i)
        y = i*m.cos(i)
        z = i
    
    pt = rs.AddPoint(x,y,z)
    pts.append(pt)
    
pts_out = pts
# ---------- end ttp_mathlibraryenum ----------
ttp_mathlibrary = TTP_mathLibrary()  # -> out, pts_out; disabled
# ---------- ttp_mathlibrary: Python ----------
import rhinoscriptsyntax as rs
import math as m

pts =[]

for i in rs.frange(fstart, 100.0, fstep):
    x = i*m.sin(i)
    y = i*m.cos(i)
    z = i
    
    pt = rs.AddPoint(x,y,z)
    pts.append(pt)
    
pts_out = pts
# ---------- end ttp_mathlibrary ----------
wsgh_2darrayofpoints = WSGH_2DArrayOfPoints()  # -> out, pts_out; inputs n: Int32; disabled
# ---------- wsgh_2darrayofpoints: Python ----------
__author__ = "Sculpture"
__version__ = "2021.01.18"

import Rhino.Geometry as rg
import rhinoscriptsyntax as rs
import random as r

pts = []

for i in range(n):
    pt = rs.AddPoint(r.uniform(0,10),r.uniform(0,10),0)
    pts.append(pt)

pts_out = pts
# ---------- end wsgh_2darrayofpoints ----------
wsgh_3darrayofpoints = WSGH_3DArrayOfPoints()  # -> out, pts, R_out, G_out, B_out; inputs step: Int32, RGB: Int32; disabled
# ---------- wsgh_3darrayofpoints: Python ----------
__author__ = "Sculpture"
__version__ = "2021.01.20"

import rhinoscriptsyntax as rs

pts = []
R = []
G = []
B = []

for x in range(0,256,step):
    for y in range(0,256,step): 
        for z in range(0,256,step):
            pt = rs.AddPoint(x,y,z)
            pts.append(pt)
            R.append(x)
            G.append(y)            
            B.append(z)
pts_out = pt
R_out = R
G_out = G
B_out = B
# ---------- end wsgh_3darrayofpoints ----------
wsgh_arrayofpoints = WSGH_arrayOfPoints()  # -> out, pts1_out, pts2_out; inputs x: Int32, y: Int32; disabled
# ---------- wsgh_arrayofpoints: Python ----------
__author__ = "Sculpture"
__version__ = "2021.01.18"

import Rhino.Geometry as rg

pts1 = []
pts2 = []

for i in range(x):
    pt = rg.Point3d(i, 0, 0)
    pts1.append(pt)
    pts2.extend(pt)

pts1_out = pts1
pts2_out = pts2
# ---------- end wsgh_arrayofpoints ----------
# 2 GEOMETRY
# Points
wsgh_numbersliderpoints = WSGH_numbersliderPoints()  # -> out, pt1_out, pt2_out; inputs x: Int32, y: Int32; disabled
# ---------- wsgh_numbersliderpoints: Python ----------
__author__ = "Sculpture"
__version__ = "2021.01.18"

import rhinoscriptsyntax as rs
import Rhino.Geometry as rg

pt1 = rg.Point3d(x, 0, 0)
pt2 = rs.AddPoint(0, y, 0)

pt1_out = pt1
pt2_out = pt2
# ---------- end wsgh_numbersliderpoints ----------
wsgh_conditionalexample1 = WSGH_conditionalExample1()  # -> out, pts_out; inputs x: Int32, y: Int32; disabled
# ---------- wsgh_conditionalexample1: Python ----------
__author__ = "Sculpture"
__version__ = "2021.01.18"

import Rhino.Geometry as rg
import rhinoscriptsyntax as rs

pts = []

for i in range(x):
    if i < y:
        pt = rs.AddPoint(i,0,0)
        pts.append(pt)
    else:
        pt = rs.AddPoint(i,10,0)
        pts.append(pt)
pts_out = pts
# ---------- end wsgh_conditionalexample1 ----------
wsgh_conditionalpoints = WSGH_conditionalPoints()  # -> out, pts_out; inputs x: Int32, y: Int32; disabled
# ---------- wsgh_conditionalpoints: Python ----------
import rhinoscriptsyntax as rs

pts = []

for i in range(x):
    if i < y:
        pt = rs.AddPoint(i, 0, 0)
        pts.append(pt)
    else:
        pt = rs.AddPoint(i, 0, z)
        pts.append(pt)

pts_out = pts
# ---------- end wsgh_conditionalpoints ----------
wsgh_mathlibrary = WSGH_mathLibrary()  # -> out, pts_out; disabled
# ---------- wsgh_mathlibrary: Python ----------
__author__ = "Sculpture"
__version__ = "2021.01.20"

import rhinoscriptsyntax as rs
import math as m

pts = []

for i in rs.frange(0.0, 100.0, 0.1):
    x = i*m.sin(i)
    y = i*m.cos(i)
    z = i
    
    pt = rs.AddPoint(x,y,z)
    pts.append(pt)
    
pts_out = pts
# ---------- end wsgh_mathlibrary ----------
ttp_randompoints = TTP_randomPoints()  # -> out, curve_out; inputs count: Int32, numX: Int32, numY: Int32, numZ: Int32, SEED: Int32
# ---------- ttp_randompoints: Python ----------
import rhinoscriptsyntax as rs
import random

pts = []

for i in range(0,count):
    x = random.uniform(0,numX)
    y = random.uniform(0,numY)    
    z = random.uniform(0,numZ)
    pt = rs.AddPoint(x,y,z)
    pts.append(pt)

curve = rs.AddCurve(pts)
curve_out = curve
# ---------- end ttp_randompoints ----------
ttp_funwithconditionals = TTP_funWithconditionals()  # -> out, pts1_out, pts2_out, pts3_out; inputs x: Int32, y: Int32, num1: Int32, num2: Int32, z: Int32
# ---------- ttp_funwithconditionals: Python ----------
import rhinoscriptsyntax as rs

pts1 = []
pts2 = []
pts3 = []

for i in range(0,x,1):
    for j in range(0,y,1):
        #pt = rs.AddPoint(i,j,z)
        if i % num1 == 0 and j % num2 ==0:
            pt = rs.AddPoint(i,j,z)
            
            pts1.append(pt)
        elif i % num1 == 0 or j % num2 == 0:
            pt = rs.AddPoint(i,j,z+z)
            
            pts2.append(pt)
        else:
            pt = rs.AddPoint(i,j,z+z+z)
            
            pts3.append(pt)

pts1_out = pts1
pts2_out = pts2
pts3_out = pts3
# ---------- end ttp_funwithconditionals ----------
ttp_random3darrayofpoints = TTP_random3DArrayOfPoints()  # -> out, pts, R_out, G_out, B_out; inputs step: Int32, RGB: Int32, SEED: Int32, enumX: Int32, enumY: Int32, enumZ: Int32
# ---------- ttp_random3darrayofpoints: Python ----------
import rhinoscriptsyntax as rs
import random as r
import math as m

r.seed(SEED)
pts = []
R = []
G = []
B = []

for x in range(0, RGB, step):
    for y in range(0, RGB, step):
        for z in range(0, RGB, step):
            if enumX == 0 and enumY == 0 or enumZ == 0:
                pt = rs.AddPoint(r.uniform(0,x),y,z)
                pts.append(pt)
                R.append(x)
                G.append(y)
                B.append(z)
            elif enumX == 0 or enumY == 0 and enumZ == 0:
                pt = rs.AddPoint(r.uniform(0,x),r.uniform(0,y),z)
                pts.append(pt)
                R.append(x)
                G.append(y)
                B.append(z)
            else:
                pt = rs.AddPoint(r.uniform(0,x),r.uniform(0,y),r.uniform(0,z))
                pts.append(pt)
                R.append(x)
                G.append(y)
                B.append(z)


pts_out = pts
R_out = R
G_out = G
B_out = B
# ---------- end ttp_random3darrayofpoints ----------
ttp_randompoint2d = TTP_randomPoint2D()  # -> out, pts_out; inputs seed: Int32, n: Int32, x: Int32, y: Int32
# ---------- ttp_randompoint2d: Python ----------
import rhinoscriptsyntax as rs
import random as r

r.seed(seed)
pts = []

for i in range(n):
    pt = rs.AddPoint(r.uniform(0,x), r.uniform(0,y),0)
    pts.append(pt)
    
pts_out = pts
# ---------- end ttp_randompoint2d ----------
wsgh_3darrayofpoints_2 = WSGH_3DArrayOfPoints()  # -> out, pts, R_out, G_out, B_out; inputs step: Int32, RGB: Int32; disabled; same code as wsgh_3darrayofpoints
ttp_random = TTP_random()  # -> out, ran1_out, ran2_out, ran3_out; inputs x: Int32, y: Int32; disabled
# ---------- ttp_random: Python ----------
import random

random.seed(s)
ran1 = random.random()
ran2 = random.randint(x,y)
ran3 = random.uniform(x,y)

ran1_out = ran1
ran2_out = ran2
ran3_out = ran3
# ---------- end ttp_random ----------
# 3 GEOMETRY
# Lines
ttp_arrayofpoints = TTP_arrayOfPoints()  # -> out, pts_out; inputs x: Int32
# ---------- ttp_arrayofpoints: Python ----------
import rhinoscriptsyntax as rs

pts = []

for i in range(x):
    pt = rs.AddPoint(i,y,0)
    pts.append(pt)

pts_out = pts
# ---------- end ttp_arrayofpoints ----------
ttp_random_2 = TTP_random()  # -> out, ran1_out, ran2_out, ran3_out; inputs x: Int32, y: Int32; disabled; same code as ttp_random
wsgh_pointinclosedcurve = WSGH_pointInClosedCurve()  # -> out, ptIn_out, ptOut_out; inputs Curve: Curve; disabled
# ---------- wsgh_pointinclosedcurve: Python ----------
__author__ = "Sculpture"
__version__ = "2021.01.20"

import rhinoscriptsyntax as rs
import random as r

pts = []
for i in range(100):
    pt = rs.AddPoint(r.uniform(0,100), r.uniform(0,100), 0)
    pts.append(pt)

boolean = []
ptIn = []
ptOut = []

for i in range(len(pts)):
    pt_in_or_not = rs.PointInPlanarClosedCurve(pts[i],Curve)
    boolean.append(pt_in_or_not)
    if boolean[i] ==True:
        ptIn.append(pts[i])
    if boolean[i] == False:
        ptOut.append(pts[i])

ptIn_out = ptIn
ptOut_out = ptOut
# ---------- end wsgh_pointinclosedcurve ----------
wsgh_polycurveinterp = WSGH_polyCurveInterp()  # -> out, curveA_out, curveB_out, curveC_out; inputs pts: list of Point3d; disabled
# ---------- wsgh_polycurveinterp: Python ----------
__author__ = "Sculpture"
__version__ = "2021.01.20"

import rhinoscriptsyntax as rs

curveA = rs.AddPolyline(pts)
curveB = rs.AddCurve(pts)
curveC = rs.AddInterpCurve(pts)

curveA_out = curveA
curveB_out = curveB
curveC_out = curveC
# ---------- end wsgh_polycurveinterp ----------
wsgh_linecurve = WSGH_lineCurve()  # -> out, line_out; inputs pt1: Point3d, pt2: Point3d; disabled
# ---------- wsgh_linecurve: Python ----------
__author__ = "Sculpture"
__version__ = "2021.01.20"

import rhinoscriptsyntax as rs

line = rs.AddLine(pt1, pt2)
line_out = line
# ---------- end wsgh_linecurve ----------
wsgh_curverandompoint = WSGH_curveRandomPoint()  # -> out, curve_out; inputs x: Int32, y: Int32, z: Int32; disabled
# ---------- wsgh_curverandompoint: Python ----------
__author__ = "Sculpture"
__version__ = "2021.01.20"

import rhinoscriptsyntax as rs
import random
pts = []

for i in range(0,x+y+z):
    xR = random.uniform(0,x)
    yR = random.uniform(0,y)    
    zR = random.uniform(0,z)  
    pt = rs.AddPoint(xR,yR,zR)
    pts.append(pt)
    
curve = rs.AddCurve(pts)
curve_out = curve
# ---------- end wsgh_curverandompoint ----------
ttp_polycurveinter = TTP_polyCurveInter()  # -> out, crvA_out, crvB_out, crvC_out; inputs pts: list of Point3d, degree: Int32; disabled
# ---------- ttp_polycurveinter: Python ----------
import rhinoscriptsyntax as rs

crvA = rs.AddPolyline(pts)
crvB = rs.AddCurve(pts, degree)
crvC = rs.AddInterpCurve(pts)

crvA_out = crvA
crvB_out = crvB
crvC_out = crvC
# ---------- end ttp_polycurveinter ----------
ttp_pointsinclosedcurve = TTP_pointsInClosedCurve()  # -> out, ptIn_out, ptOut_out; inputs curve: Curve, RANGE: Int32, x: Int32, y: Int32; disabled
# ---------- ttp_pointsinclosedcurve: Python ----------
import rhinoscriptsyntax as rs
import random as r

pts = []

for i in range(RANGE):
    pt = rs.AddPoint(r.uniform(0,x),r.uniform(0,y),0)
    pts.append(pt)
    
boolean = []
ptIn =[]
ptOut = []

for i in range(len(pts)):
    pt_in_out = rs.PointInPlanarClosedCurve(pts[i],curve)
    boolean.append(pt_in_out)
    if boolean[i] == True:
        ptIn.append(pts[i])
    if boolean[i] == False:
        ptOut.append(pts[i])

ptIn_out = ptIn
ptOut_out = ptOut
# ---------- end ttp_pointsinclosedcurve ----------
wsgh_vectornodeb = WSGH_vectorNodeB()  # -> out, vecAdd_out, vecSub_out, vecCrossProduct_out, vecAngle_out; disabled
# ---------- wsgh_vectornodeb: Python ----------
__author__ = "Sculpture"
__version__ = "2021.01.20"

import rhinoscriptsyntax as rs

vectorA = (x,y,z)
vectorB = (u,v,w)

vecAdd_out = rs.VectorAdd(vectorA, vectorB)
vecSub_out = rs.VectorSubtract(vectorB, vectorA)
vecCrossProduct_out = rs.VectorCrossProduct(vectorA, vectorB)
vecAngle_out = rs.VectorAngle(vectorA, vectorB)
# ---------- end wsgh_vectornodeb ----------
wsgh_patternwithattractors = WSGH_patternWithAttractors()  # -> out, pt2D_out, distanceList_out, circleList_out; inputs num: Int32; disabled
# ---------- wsgh_patternwithattractors: Python ----------
__author__ = "Sculpture"
__version__ = "2021.01.22"

import rhinoscriptsyntax as rs

pt2D = []
for i in range(num):
    for j in range(num):
        pt2D.append(rs.AddPoint(size*i,size*j,0))

distanceList = []

for i in range(len(pt2D)):
    distance = rs.Distance(pt2D[i], attPt)
    distanceList.append(distance)

circleList = []
for i in range(len(pt2D)):
    radius = (distanceList[i]/max(distanceList))*size/2
    circle = rs.AddCircle(pt2D[i], radius)
    circleList.append(circle)

pt2D_out = pt2D
distanceList_out = distanceList
circleList_out = circleList
# ---------- end wsgh_patternwithattractors ----------
# GH PYTHON @ WICKERSON STUDIOS
# 4 GEOMETRY
# Vectors/Copy/Attractors
wsgh_vectornodea = WSGH_vectorNodeA()  # -> out, vecLength_out, unitVec_out, vecScale_out, vecReverse_out, vecRotate_out; disabled
# ---------- wsgh_vectornodea: Python ----------
__author__ = "Sculpture"
__version__ = "2021.01.20"

import rhinoscriptsyntax as rs

vector = (x,y,z)

vecLength_out = rs.VectorLength(vector)
unitVec_out = rs.VectorUnitize(vector)
vecScale_out = rs.VectorScale(vector, scale)
vecReverse_out = rs.VectorReverse(vector)
vecRotate_out = rs.VectorRotate(vector, rot, [0,0,1])
# ---------- end wsgh_vectornodea ----------
wsgh_patternfromattractors = WSGH_patternFromAttractors()  # -> out, pt2D_out, curveList_out; inputs n: Int32, size: Int32, attPt: Point3d, degree: Int32; disabled
# ---------- wsgh_patternfromattractors: Python ----------
__author__ = "Sculpture"
__version__ = "2021.01.21"

import rhinoscriptsyntax as rs

pt2D = []
curveList = []

for i in range(n):
    for j in range(n):
        pt2D.append(rs.AddPoint(size*i, size*j, 0))

for k in range(len(pt2D)):
    IPCPts = []
    for m in range(degree):
        tmpVector = rs.VectorCreate(attPt, pt2D[k])
        unitVector = rs.VectorUnitize(tmpVector)
        vector = rs.VectorScale(unitVector,mult)
        vector = rs.VectorRotate(vector,angle,[0,0,1])
        newPt = rs.CopyObject(pt2D[k],vector)
        IPCPts.append(newPt)
        pt2D[k] = newPt

    curve = rs.AddInterpCurve(IPCPts,3)
    curveList.append(curve)

pt2D_out = pt2D
curveList_out = curveList
# ---------- end wsgh_patternfromattractors ----------
wsgh_rectangularpatternseveralattractorb = WSGH_rectangularPatternSeveralAttractorB()  # -> out, circleList_out; inputs num: Int32, attPts: list; disabled
# ---------- wsgh_rectangularpatternseveralattractorb: Python ----------
__author__ = "Sculpture"
__version__ = "2021.01.22"

import rhinoscriptsyntax as rs

pt2D = []
for i in range(num):
    for j in range(num):
        pt2D.append(rs.AddPoint(size*i,size*j,0))

closestAttList = []
distanceList = []

for i in range(len(pt2D)):
    index = rs.PointArrayClosestPoint(attPts,pt2D[i])
    closestAttPt = attPts[index]
    distance = rs.Distance(pt2D[i], closestAttPt)
    closestAttList.append(closestAttPt)
    distanceList.append(distance)

circleList = []

for i in range(len(pt2D)):
    radius = (distanceList[i]/max(distanceList))*size/2
    circle = rs.AddCircle(pt2D[i], radius)
    circleList.append(circle)
    
circleList_out = circleList
# ---------- end wsgh_rectangularpatternseveralattractorb ----------
wsgh_patternwithattractorsb = WSGH_patternWithAttractorsB()  # -> out, pt2D_out, radius_out, circleList_out; inputs num: Int32; disabled
# ---------- wsgh_patternwithattractorsb: Python ----------
__author__ = "Sculpture"
__version__ = "2021.01.22"

import rhinoscriptsyntax as rs
import math as m

pt2D = []
for i in range(num):
    for j in range(num):
        pt2D.append(rs.AddPoint(size*i,size*j,0))

distanceList = []

for i in range(len(pt2D)):
    distance = rs.Distance(pt2D[i], attPt)
    distanceList.append(distance)

circleList = []
radiusList = []

for i in range(len(pt2D)):
    radius = abs(m.sin(m.radians(distanceList[i])*f)*size/2)
    circle = rs.AddCircle(pt2D[i], radius)
    circleList.append(circle)
    radiusList.append(radius)

pt2D_out = pt2D
circleList_out = circleList
radius_out = radiusList
# ---------- end wsgh_patternwithattractorsb ----------
wsgh_vectorfromattactpoint = WSGH_vectorFromAttactPoint()  # -> out, pt2D_out, newPt_out, lineList_out; inputs size: Int32, attPt: Point3d; disabled
# ---------- wsgh_vectorfromattactpoint: Python ----------
__author__ = "Sculpture"
__version__ = "2021.01.21"

import rhinoscriptsyntax as rs

def Scalingvector(pt1,pt2,scale):
    tmpVec = rs.VectorCreate(pt2,pt1)
    unitVec = rs.VectorUnitize(tmpVec)
    vec = rs.VectorScale(unitVec,scale)
    newPt = rs.CopyObject(pt1,vec)
    vLine = rs.AddLine(pt1,newPt)
    
    return newPt, vLine

pt2D = []
newPt = []
lineList = []

for i in range(10):
    for j in range(10):
        pt2D.append(rs.AddPoint(size*i,size*j,0))

for i in range(len(pt2D)):
    
    pt,line = Scalingvector(pt2D[i],attPt,scale)
    newPt.append(pt)
    lineList.append(line)

pt2D_out = pt2D
newPt_out = newPt
lineList_out = lineList
# ---------- end wsgh_vectorfromattactpoint ----------
wsgh_rectangularpatternoneattractor = WSGH_rectangularPatternOneAttractor()  # -> out, rectList_out; inputs num: Int32; disabled
# ---------- wsgh_rectangularpatternoneattractor: Python ----------
__author__ = "Sculpture"
__version__ = "2021.01.22"

import rhinoscriptsyntax as rs

pt2D = []
for i in range(num):
    for j in range(num):
        pt2D.append(rs.AddPoint(size*i,size*j,0))

distanceList = []

for i in range(len(pt2D)):
    distance = rs.Distance(pt2D[i], attPt)
    distanceList.append(distance)

rectList = []

for i in range(len(pt2D)):
    angle = distanceList[i]
    plane = rs.PlaneFromNormal(pt2D[i], rs.VectorAdd([0,0,0],[0,0,1]))
    rect = rs.AddRectangle(plane,size/1.6,size/1.6)
    rotateRect = rs.RotateObject(rect,pt2D[i],angle*f)
    rectList.append(rotateRect)
    
rectList_out = rectList
# ---------- end wsgh_rectangularpatternoneattractor ----------
wsgh_vectorcopymove = WSGH_vectorCopyMove()  # -> out, pts_out; inputs count: Int32; disabled
# ---------- wsgh_vectorcopymove: Python ----------
__author__ = "Sculpture"
__version__ = "2021.01.20"

import rhinoscriptsyntax as rs

pts = []
pt = rs.AddPoint(0,0,0)
pts.append(pt)

vec = (x,y,z)

for i in range(count):
    newPt = rs.CopyObject(pts[-1], vec)
    pts.append(newPt)
pts_out = pts
rs.CopyObject(
# ---------- end wsgh_vectorcopymove ----------
wsgh_copymovepoints = WSGH_copyMovePoints()  # -> out, pts_out, polyline_out; inputs y: Int32; disabled
# ---------- wsgh_copymovepoints: Python ----------
__author__ = "Sculpture"
__version__ = "2021.01.21"

import rhinoscriptsyntax as rs

pts = []
pt = rs.AddPoint(0,0,0)
pts.append(pt)

vec1 = (x,0,0)
vec2 = (0,x,0)

for i in range(y):
    newPt = rs.CopyObject(pts[-1], vec1)
    pts.append(newPt)
    newPt = rs.CopyObject(pts[-1], vec2)
    pts.append(newPt)
    
polyline = rs.AddPolyline(pts)

pts_out = pts
polyline_out = polyline
# ---------- end wsgh_copymovepoints ----------
wsgh_copymovepointsb = WSGH_copyMovePointsB()  # -> out, pts_out, polyline_out; inputs y: Int32; disabled
# ---------- wsgh_copymovepointsb: Python ----------
__author__ = "Sculpture"
__version__ = "2021.01.21"

import rhinoscriptsyntax as rs
import random

pts = []
pt = rs.AddPoint(0,0,0)
pts.append(pt)

for i in range(y):
    xDir = random.uniform(-x, x*x)
    yDir = random.uniform(-x, x*x)
    zDir = random.uniform(-x, x*x)
    vec = (xDir, yDir, zDir)
    newPt = rs.CopyObject(pts[-1], vec)
    pts.append(newPt)
    
#polyline = rs.AddPolyline(pts)
polyline = rs.AddInterpCurve(pts)

pts_out = pts
polyline_out = polyline
# ---------- end wsgh_copymovepointsb ----------
ttp_awesomevectornode_2 = TTP_awesomeVectorNode2()  # -> out, vecA, vecB, vecAdd_out, vecSub_out, vecCrossProduct_out, vecAngle_out
# ---------- ttp_awesomevectornode_2: Python ----------
import rhinoscriptsyntax as rs

vecA = (x,y,z)
vecB = (a,b,c)

vecAdd_out = rs.VectorAdd(vecA,vecB)
vecSub_out = rs.VectorSubtract(vecB, vecA)
vecCrossProduct_out = rs.VectorCrossProduct(vecA, vecB)
vecAngle_out = rs.VectorAngle(vecA,vecB)
# ---------- end ttp_awesomevectornode_2 ----------
ttp_awsomevectornode = TTP_awsomeVectorNode()  # -> out, vecLength_out, unitVec_out, vecScale_out, vecReverse_out, vecRotate_out; inputs axis: Vector3d
# ---------- ttp_awsomevectornode: Python ----------
import rhinoscriptsyntax as rs

vector = (x,y,z)

vecLength_out = rs.VectorLength(vector)
unitVec_out = rs.VectorUnitize(vector)
vecScale_out = rs.VectorScale(vector, factor)
vecReverse_out = rs.VectorReverse(vector)
vecRotate_out = rs.VectorRotate(vector, degree, axis)
# ---------- end ttp_awsomevectornode ----------
ttp_movespheres = TTP_moveSpheres()  # -> out, spheres_out; inputs count: Int32
# ---------- ttp_movespheres: Python ----------
import rhinoscriptsyntax as rs

pts = []
spheres = []

pt = rs.AddPoint(0,0,0)
vec = (10,10,10)

sphere = rs.AddSphere(pt, radius)
spheres.append(sphere)
print sphere

for i in range(count):
    newSphere = rs.CopyObject(spheres[-1], vec)
    spheres.append(newSphere)
    print(spheres[i])

spheres_out = spheres
# ---------- end ttp_movespheres ----------
ttp_movesphereswithvec = TTP_moveSpheresWithVec()  # -> out, pts_out, spheres_out; inputs count: Int32; disabled
# ---------- ttp_movesphereswithvec: Python ----------
import rhinoscriptsyntax as rs

pts = []
pt = rs.AddPoint(0,0,0)
pts.append(pt)

vec = (x,y,z)

for i in range(count):
    newPt = rs.CopyObject(pts[-1], vec)
    pts.append(newPt)
    print(pts[i])

pts_out = pts

spheres = []
sphere = rs.AddSphere(pt, radius)
spheres.append(sphere)
print " "
print sphere

for i in range(count):
    newSphere = rs.CopyObject(spheres[-1],vec)
    spheres.append(newSphere)
    print(spheres[i])

spheres_out = spheres
# ---------- end ttp_movesphereswithvec ----------
ttp_curvedomain = TTP_curveDomain()  # -> out, startDomain_out, endDomain_out; inputs curve: Curve; disabled
# ---------- ttp_curvedomain: Python ----------
import rhinoscriptsyntax as rs

domain = rs.CurveDomain(curve)
startDomain = domain[0]

endDomain = domain[1]
startPoint = rs.EvaluateCurve(curve, startDomain)
endPoint = rs.EvaluateCurve(curve,endDomain)

print(domain)
startDomain_out = startPoint
endDomain_out = endPoint
# ---------- end ttp_curvedomain ----------
# 5 GEOMETRY
# Curves: attractors/Domain
wsgh_patternwithcurveattractor = WSGH_patternWithCurveAttractor()  # -> out, distanceList, circleList_out; inputs num: Int32, curve: Curve; disabled
# ---------- wsgh_patternwithcurveattractor: Python ----------
__author__ = "Sculpture"
__version__ = "2021.01.22"

import rhinoscriptsyntax as rs

pt2D = []
for i in range(num):
    for j in range(num):
        pt2D.append(rs.AddPoint(size*i,size*j,0))

distanceList = []
for i in range(len(pt2D)):
    t = rs.CurveClosestPoint(curve,pt2D[i])
    ptOnCurve = rs.EvaluateCurve(curve,t)
    distance = rs.Distance(ptOnCurve,pt2D[i])
    distanceList.append(distance)

circleList =[]
for i in range(len(pt2D)):
    radius = (distanceList[i]/max(distanceList))*size/2
    circle = rs.AddCircle(pt2D[i], radius)
    circleList.append(circle)

circleList_out = circleList
# ---------- end wsgh_patternwithcurveattractor ----------
